# Dynamo graph AFD_Tower_GraphMap.dyn (Dynamo 2.10.1.3976)
# packages: Celery for Dynamo 2.5 20.6.7, Ampersand 2019.12.31

levels = DoubleSlider(55, range=1..100 step 1)
floor_height = DoubleSlider(450, range=400..600 step 50)
sequence = Sequence(amount=levels, step=floor_height)

# group: Utworzenie obrysów kondygnacji
byCoordinates = Point.ByCoordinates()
translate = Geometry.Translate(geometry=byCoordinates, zTranslation=sequence)
radius = DoubleSlider(3250, range=2000..10000 step 250)
radius_2 = DoubleSlider(4250, range=2000..5000 step 250)
graphMap = GraphMap(minLimit=radius, maxLimit=radius_2, count=levels, CurveType="Parabola", PointFreeSine1="0,0", PointFreeSine2="294,258", PointBezier1="0,258,True", PointBezier2="294,258,False", PointBezCont1="50,100", PointBezCont2="244,100", PointLinear1="0,258", PointLinear2="294,0", PointParabolic1="147,0", PointParabolic2="294,258", PointPerlin01="147,0,0,0,False", PointPerlin02="1,258,0,0,True", PointPerlin11="147,129")
byCenterPointRadius = Circle.ByCenterPointRadius(centerPoint=translate, radius=graphMap)
sides = DoubleSlider(12, range=5..20 step 1)
regularPolygon = Polygon.RegularPolygon(circle=byCenterPointRadius, numberSides=sides)

code_block = CodeBlock(x=sides) { 0..1..#x+1; }
pointAtParameter = Curve.PointAtParameter(curve=regularPolygon, param=code_block, lacing=CrossProduct)
flatten = List.Flatten(list=pointAtParameter@L2)
# note: Utworzenie kondygnacji (Levels) w Revicie
byElevation = Level.ByElevation(elevation=sequence)

# group: Utworzenie stropów
byPoints = PolyCurve.ByPoints(points=flatten)
floor_types = FloorTypes("Standard")
# note: Utworzenie polikrzywej
byOutlineTypeAndLevel = Floor.ByOutlineTypeAndLevel(outline=byPoints, floorType=floor_types, level=byElevation)

# note: Code Block, który eliminuje ścianę nad ostatnią kondygnacją
code_block_2 = CodeBlock(x=levels) { 0..x-2; }
watch = Watch(code_block_2)

# group: Utworzenie ścian pomiędzy stropami
curves = PolyCurve.Curves(polyCurve=regularPolygon)
getItemAtIndex = List.GetItemAtIndex(list=byElevation, index=watch)
wall_types = WallTypes("Curtain_Wall-Storefront")
byCurveAndHeight = Wall.ByCurveAndHeight(curve=curves, height=floor_height, level=getItemAtIndex, wallType=wall_types)

# group: Odsunięcie obrysów kondygnacji dla ściany osłonowej
radius_3 = DoubleSlider(100, range=100..500 step 50)
radius_4 = DoubleSlider(450, range=100..500 step 50)
graphMap_2 = GraphMap(minLimit=radius_3, maxLimit=radius_4, count=levels, CurveType="PerlinNoise", PointFreeSine1="0,0", PointFreeSine2="294,258", PointBezier1="0,258,True", PointBezier2="294,258,False", PointBezCont1="50,100", PointBezCont2="244,100", PointLinear1="0,258", PointLinear2="294,0", PointParabolic1="147,0", PointParabolic2="294,258", PointPerlin01="147,0,0,0,False", PointPerlin02="1,258,0,0,True", PointPerlin11="147,129")
offset = Curve.Offset(curve=byCenterPointRadius, distance=graphMap_2)

# group: Utworzenie listy punktów do "panelingu"
# note: Utworzenie powierzchni
byLoft = Surface.ByLoft(crossSections=offset)
code_block_3 = CodeBlock { 1; }
integer_slider = IntegerSlider(36, range=20..80 step 1)
code_block_4 = CodeBlock(v=integer_slider) { 0..1..#v; }
getIsoline = Surface.GetIsoline(surface=byLoft, isoDirection=code_block_3, parameter=code_block_4)
intersect = Geometry.Intersect(geometry=offset, other=getIsoline, lacing=CrossProduct)
flatten_2 = List.Flatten(list=intersect@L3)

# group: Utworzenie ściany osłonowej wykorzystującej "adaptive component"
pointgrid_toquadsets = Custom[[&] PointGrid.ToQuadSets](pointGrid=flatten_2)  # package Ampersand; Create groups of 4 items describing the "cells" of a rectangular grid of data. In the case of a grid of points, the output will be the set of points describing the corners of 4-pointed panels.
family_types = FamilyTypes("AFD_adaptive family:AFD_adaptive family")
byPoints_2 = AdaptiveComponent.ByPoints(points=pointgrid_toquadsets, familyType=family_types)
